# Grasshopper definition הדפסת_חול_קוד_ראשי.gh (Grasshopper 1.0.7)
# plug-ins: PTComponentLibrary, Robots, ShapeDiverForGrasshopper

# scale, loft and contour curve
number_slider = Slider(300, range=0..1000)
רדיוס_מעגל_פנימי = Slider(355, range=50..1800)
זווית_מתוך_המעגל = Slider(180, range=0..1000)
מספק_חלוקות = Slider(17, range=1..51)
עובי_הוצאת_חומר_ממ = Slider(73, range=0..100)
unit_z = UnitZ(Factor=number_slider)
# scale, loft and contour curve
number_slider_2 = Slider(300, range=0..1000)
# one curve with slalums
point = Point(Point(31.64095838, 55.54642388, 0))
unit_z_2 = UnitZ(Factor=1)
# scale, loft and contour curve
number_slider_3 = Slider(300, range=0..1000)
unit_z_3 = UnitZ(Factor=number_slider_2)
radians = Radians(Degrees=זווית_מתוך_המעגל)
number_slider_4 = Slider(100, range=0..100)
unit_z_4 = UnitZ(Factor=number_slider_3)
unit_z_5 = UnitZ(Factor=1)
arc = Arc(Plane=point, Radius=רדיוס_מעגל_פנימי, Angle=radians)  # -> Arc, Length
unit_z_6 = UnitZ(Factor=1)
divide_curve = DivideCurve(Curve=arc.Arc, Count=מספק_חלוקות, Kinks=False)  # -> Points, Tangents, Parameters
cull_index = CullIndex(List=divide_curve.Points, Indices="0", Wrap=True)
line = Line(StartPoint=divide_curve.Points, EndPoint=cull_index)
curve_middle = CurveMiddle(Curve=line)
distance = Distance(PointA=divide_curve.Points, PointB=cull_index)
expression = Expression(D=distance, Expression="D/2")
vector_2pt = Vector2Pt(PointA=curve_middle, PointB=point, Unitize=False)  # -> Vector, Length
amplitude = Amplitude(Vector=vector_2pt.Vector, Amplitude=expression)
move = Move(Geometry=curve_middle, Motion=amplitude)  # -> Geometry, Transform
number_slider_5 = Slider(720, range=0..1000)
number_slider_6 = Slider(90, range=0..100)
unit_z_7 = UnitZ(Factor=Slider(-822, range=-2000..1000))
unit_x = UnitX(Factor=Slider(200, range=0..1000))
arc_3pt = Arc3Pt(PointA=divide_curve.Points, PointB=move.Geometry, PointC=cull_index)  # -> Arc, Plane, Radius
unit_y = UnitY(Factor=Slider(-100, range=-1500..1000))
xy_plane = XYPlane(Origin=Point(0, 0, 0))
dispatch = Dispatch(List=arc_3pt.Arc, DispatchPattern=[True, False])  # -> ListA, ListB
dispatch_2 = Dispatch(List=arc_3pt.Plane, DispatchPattern=[True, False])  # -> ListA, ListB
rotate = Rotate(Geometry=dispatch.ListA, Angle=degrees(Slider(180, range=0..1000)), Plane=dispatch_2.ListA)  # -> Geometry, Transform
# סידור המישורים
list = FlagFields({"Shoulder": 1, "Elbow": 2, "Wrist": 4}, selected=["Shoulder", "Elbow"])
list_2 = ValueList({"Joint", "Linear"}, selected="Joint")
curve_middle_2 = CurveMiddle(Curve=rotate.Geometry)
list_item = ListItem(List=curve_middle_2, Index="0", Wrap=True)
list_item_2 = ListItem(List=expression, Index="0", Wrap=True)
expression_2 = Expression(R=list_item_2, x=Slider(2, range=2..4), Expression="x*R")
file_path = FilePath("/Users/nofnathansohn/Documents/Nof/NSoA/soil 3d printing/2024/mountain/printing/")
offset_curve = OffsetCurve(Curve=arc.Arc, Distance=expression_2, Corners=1)
divide_curve_2 = DivideCurve(Curve=offset_curve, Count=מספק_חלוקות, Kinks=False)  # -> Points, Tangents, Parameters
# הרדיוסים תכלס זהים צריך רק אחד מהם
number_slider_7 = Slider(55000, range=0..55000)
cull_index_2 = CullIndex(List=divide_curve_2.Points, Indices="0", Wrap=True)
line_2 = Line(StartPoint=divide_curve_2.Points, EndPoint=cull_index_2)
curve_middle_3 = CurveMiddle(Curve=line_2)
distance_2 = Distance(PointA=divide_curve_2.Points, PointB=cull_index_2)
expression_3 = Expression(D=distance_2, Expression="D/2")
vector_2pt_2 = Vector2Pt(PointA=curve_middle_3, PointB=point, Unitize=False)  # -> Vector, Length
amplitude_2 = Amplitude(Vector=vector_2pt_2.Vector, Amplitude=expression_3)
move_2 = Move(Geometry=curve_middle_3, Motion=amplitude_2)  # -> Geometry, Transform
list_item_3 = ListItem(List=move_2.Geometry, Index="0", Wrap=True)
distance_3 = Distance(PointA=list_item, PointB=list_item_3)
evaluate = Evaluate(Expression="(0.2*W)<D", D=distance_3, W=עובי_הוצאת_חומר_ממ)  # -> flatten(Result)
panel = Panel(evaluate)
arc_3pt_2 = Arc3Pt(PointA=divide_curve_2.Points, PointB=move_2.Geometry, PointC=cull_index_2)  # -> Arc, Plane, Radius
dispatch_3 = Dispatch(List=arc_3pt_2.Arc, DispatchPattern=[True, False])  # -> ListA, ListB
dispatch_4 = Dispatch(List=arc_3pt_2.Plane, DispatchPattern=[True, False])  # -> ListA, ListB
rotate_2 = Rotate(Geometry=dispatch_3.ListB, Angle=degrees(Slider(180, range=0..1000)), Plane=dispatch_4.ListB)  # -> Geometry, Transform
join_curves = JoinCurves(Curves=[dispatch_3.ListA, rotate_2.Geometry], Preserve=False)
curve = Curve(join_curves)
move_3 = Move(Geometry=curve, Motion=unit_z_4)  # -> Geometry, Transform
curve_middle_4 = CurveMiddle(Curve=curve)
scale = Scale(Geometry=move_3.Geometry, Center=curve_middle_4, Factor=Slider(0.9, range=0..10))  # -> Geometry, Transform
loft = Loft(
    Curves=[curve, scale.Geometry],
    Options={Adjust=False, Closed=False, LoftEnds=0, LoftSimp=0, LoftType=0, Rebuild=10, Refit=0.01})
contour = Contour(Shape=loft, Point=Point(0, 0, 0), Direction=unit_z_6, Distance=Slider(6, range=0..10))  # -> flatten(Contours)
dispatch_5 = Dispatch(List=contour, DispatchPattern=[True, False])  # -> ListA, ListB
panel_2 = Panel(dispatch_5.ListB)
flip_curve = FlipCurve(Curve=dispatch_5.ListB)  # -> Curve, Flag
weave = Weave(Pattern=[0, 1], Stream0=dispatch_5.ListA, Stream1=flip_curve.Curve, NullGaps=False)
divide_distance = DivideDistance(Curve=weave, Distance=Slider(10, range=0..100), AddEnd=True)
unit_y_2 = UnitY(Factor=Slider(-10, range=-10..10))

# ---- group: פה משחקים עם הצורה
עובי_הוצאת_חומר_ממ_2 = Slider(98, range=0..100)
זווית_מתוך_המעגל_2 = Slider(180, range=0..1000)
number_slider_8 = Slider(3.3, range=2..4)
רדיוס_מעגל_פנימי_2 = Slider(195, range=50..1800)
מספק_חלוקות_2 = Slider(19, range=1..51)

# ---- group: קביעת הקשת
point_2 = Point(Point(31.64095838, 55.54642388, 0))
radians_2 = Radians(Degrees=זווית_מתוך_המעגל_2)
arc_2 = Arc(Plane=point_2, Radius=רדיוס_מעגל_פנימי_2, Angle=radians_2)  # -> Arc, Length

# ---- group: יצירת סלאלומים שהם עיגול מושלם / מציאת מרכז המרחק בין שני נקודות על העיגול
divide_curve_3 = DivideCurve(Curve=arc_2.Arc, Count=מספק_חלוקות_2, Kinks=False)  # -> Points, Tangents, Parameters
cull_index_3 = CullIndex(List=divide_curve_3.Points, Indices="0", Wrap=True)
line_3 = Line(StartPoint=divide_curve_3.Points, EndPoint=cull_index_3)
curve_middle_5 = CurveMiddle(Curve=line_3)

# ---- group: יצירת סלאלומים שהם עיגול מושלם / הזזת נקודת האמצע במרחק של חצי האורך כדי לייצר בדיוק מרכז במרחק של רדיוס
distance_4 = Distance(PointA=divide_curve_3.Points, PointB=cull_index_3)
expression_4 = Expression(D=distance_4, Expression="D/2")
vector_2pt_3 = Vector2Pt(PointA=curve_middle_5, PointB=point_2, Unitize=False)  # -> Vector, Length
amplitude_3 = Amplitude(Vector=vector_2pt_3.Vector, Amplitude=expression_4)
move_4 = Move(Geometry=curve_middle_5, Motion=amplitude_3)  # -> Geometry, Transform

# ---- group: יצירת סלאלומים שהם עיגול מושלם / סיבוב כל קשת שנייה כדי לייצר זיגזג
arc_3pt_3 = Arc3Pt(PointA=divide_curve_3.Points, PointB=move_4.Geometry, PointC=cull_index_3)  # -> Arc, Plane, Radius
dispatch_6 = Dispatch(List=arc_3pt_3.Arc, DispatchPattern=[True, False])  # -> ListA, ListB
dispatch_7 = Dispatch(List=arc_3pt_3.Plane, DispatchPattern=[True, False])  # -> ListA, ListB
rotate_3 = Rotate(Geometry=dispatch_6.ListA, Angle=degrees(Slider(180, range=0..1000)), Plane=dispatch_7.ListA)  # -> Geometry, Transform

# ----
join_curves_2 = JoinCurves(Curves=[dispatch_6.ListB, rotate_3.Geometry], Preserve=False)
list_item_4 = ListItem(List=expression_4, Index="0", Wrap=True)
expression_5 = Expression(R=list_item_4, x=number_slider_8, Expression="x*R")
offset_curve_2 = OffsetCurve(Curve=arc_2.Arc, Distance=expression_5, Corners=1)

# ---- group: מציאת מרכז המרחק בין שני נקודות על העיגול
divide_curve_4 = DivideCurve(Curve=offset_curve_2, Count=מספק_חלוקות_2, Kinks=False)  # -> Points, Tangents, Parameters
cull_index_4 = CullIndex(List=divide_curve_4.Points, Indices="0", Wrap=True)
line_4 = Line(StartPoint=divide_curve_4.Points, EndPoint=cull_index_4)
curve_middle_6 = CurveMiddle(Curve=line_4)

# ---- group: הזזת נקודת האמצע במרחק של חצי האורך כדי לייצר בדיוק מרכז במרחק של רדיוס
distance_5 = Distance(PointA=divide_curve_4.Points, PointB=cull_index_4)
expression_6 = Expression(D=distance_5, Expression="D/2")
vector_2pt_4 = Vector2Pt(PointA=curve_middle_6, PointB=point_2, Unitize=False)  # -> Vector, Length
amplitude_4 = Amplitude(Vector=vector_2pt_4.Vector, Amplitude=expression_6)
move_5 = Move(Geometry=curve_middle_6, Motion=amplitude_4)  # -> Geometry, Transform

# ---- group: בודק מה המרחק של הנקודות הקרובות ביותר בין שתי השכבות
curve_middle_7 = CurveMiddle(Curve=rotate_3.Geometry)
list_item_5 = ListItem(List=curve_middle_7, Index="0", Wrap=True)
list_item_6 = ListItem(List=move_5.Geometry, Index="0", Wrap=True)
distance_6 = Distance(PointA=list_item_5, PointB=list_item_6)
evaluate_2 = Evaluate(Expression="(0.2*W)<D", D=distance_6, W=עובי_הוצאת_חומר_ממ_2)  # -> flatten(Result)

# ---- group: פה משחקים עם הצורה (continued)
panel_3 = Panel(evaluate_2)

# ----
arc_3pt_4 = Arc3Pt(PointA=divide_curve_4.Points, PointB=move_5.Geometry, PointC=cull_index_4)  # -> Arc, Plane, Radius
dispatch_8 = Dispatch(List=arc_3pt_4.Arc, DispatchPattern=[True, False])  # -> ListA, ListB
dispatch_9 = Dispatch(List=arc_3pt_4.Plane, DispatchPattern=[True, False])  # -> ListA, ListB
rotate_4 = Rotate(Geometry=dispatch_8.ListB, Angle=degrees(Slider(180, range=0..1000)), Plane=dispatch_9.ListB)  # -> Geometry, Transform

# ---- group: יצירת הקשתות שיודפסו בפועל עם התחשבות בעובי חומר
list_item_7 = ListItem(List=expression_4, Index="0", Wrap=True)
expression_7 = Expression(R=list_item_7, W=עובי_הוצאת_חומר_ממ_2, Expression="R+0.2*W")
offset_curve_3 = OffsetCurve(Curve=arc_2.Arc, Distance=expr("-x", expression_7), Corners=1)

# ----
join_curves_3 = JoinCurves(Curves=[dispatch_8.ListA, rotate_4.Geometry], Preserve=False)

# ---- group: סגירת הקשת והסלאלום
end_points = EndPoints(Curve=join_curves_2)  # -> Start, End
end_points_2 = EndPoints(Curve=offset_curve_3)  # -> Start, End
line_5 = Line(StartPoint=end_points_2.Start, EndPoint=end_points.End)
join_curves_4 = JoinCurves(Curves=[line_5, offset_curve_3, join_curves_2], Preserve=False)

# ---- group: סגירת הסלאלום הפנימי והחיצוני
end_points_3 = EndPoints(Curve=join_curves_4)  # -> Start, End
end_points_4 = EndPoints(Curve=join_curves_3)  # -> Start, End
line_6 = Line(StartPoint=end_points_3.Start, EndPoint=end_points_4.End)
join_curves_5 = JoinCurves(Curves=flatten([join_curves_3, line_6, join_curves_4]), Preserve=False)

# ---- group: יצירת הקשתות שיודפסו בפועל עם התחשבות בעובי חומר
list_item_8 = ListItem(List=expression_6, Index="0", Wrap=True)
expression_8 = Expression(R=list_item_8, W=עובי_הוצאת_חומר_ממ_2, Expression="R+0.2*W")
offset_curve_4 = OffsetCurve(Curve=offset_curve_2, Distance=expression_8, Corners=1)

# ---- group: סגירת הסלאלום החיצוני עם הקשת שתודפס בפועל
end_points_5 = EndPoints(Curve=join_curves_5)  # -> Start, End
end_points_6 = EndPoints(Curve=offset_curve_4)  # -> Start, End
line_7 = Line(StartPoint=end_points_5.Start, EndPoint=end_points_6.Start)
join_curves_6 = JoinCurves(Curves=flatten([line_7, offset_curve_4, join_curves_5]), Preserve=False)

# ----
end_points_7 = EndPoints(Curve=join_curves_6)  # -> Start, End
move_6 = Move(Geometry=[end_points_7.Start, end_points_7.End], Motion=unit_y_2)  # -> Geometry, Transform
panel_4 = Panel(move_6.Geometry)
dispatch_10 = Dispatch(List=panel_4, DispatchPattern=[True, False])  # -> ListA, ListB
line_8 = Line(StartPoint=end_points_7.End, EndPoint=dispatch_10.ListB)
line_9 = Line(StartPoint=dispatch_10.ListB, EndPoint=dispatch_10.ListA)
join_curves_7 = JoinCurves(Curves=[join_curves_6, line_8, line_9], Preserve=False)
curve_2 = Curve(join_curves_7)
move_7 = Move(Geometry=curve_2, Motion=unit_z)  # -> Geometry, Transform
curve_middle_8 = CurveMiddle(Curve=curve_2)
scale_2 = Scale(Geometry=move_7.Geometry, Center=curve_middle_8, Factor=Slider(1.1, range=0..10))  # -> Geometry, Transform
loft_2 = Loft(
    Curves=[curve_2, scale_2.Geometry],
    Options={Adjust=False, Closed=False, LoftEnds=0, LoftSimp=0, LoftType=0, Rebuild=10, Refit=0.01})
contour_2 = Contour(Shape=loft_2, Point=Point(0, 0, 0), Direction=unit_z_2, Distance=Slider(8, range=0..10))
dispatch_11 = Dispatch(List=contour_2, DispatchPattern=[True, False])  # -> ListA, ListB
flip_curve_2 = FlipCurve(Curve=dispatch_11.ListB)  # -> Curve, Flag
weave_2 = Weave(Pattern=[0, 1], Stream0=dispatch_11.ListA, Stream1=flip_curve_2.Curve, NullGaps=False)
divide_distance_2 = DivideDistance(Curve=contour_2, Distance=Slider(10, range=0..100), AddEnd=True)
end_points_8 = EndPoints(Curve=join_curves_7)  # -> Start, End
point_3 = Point(end_points_8.Start)
point_4 = Point(end_points_8.End)

# ---- group: פה משחקים עם הצורה
עובי_הוצאת_חומר_ממ_3 = Slider(60, range=0..100)
זווית_מתוך_המעגל_3 = Slider(45, range=0..1000)
number_slider_9 = Slider(2.8, range=2..4)
רדיוס_מעגל_פנימי_3 = Slider(343, range=200..1800)
מספק_חלוקות_3 = Slider(7, range=1..51)

# ---- group: קביעת הקשת
point_5 = Point(Point(31.64095838, 55.54642388, 0))
radians_3 = Radians(Degrees=זווית_מתוך_המעגל_3)
arc_3 = Arc(Plane=point_5, Radius=רדיוס_מעגל_פנימי_3, Angle=radians_3)  # -> Arc, Length

# ---- group: יצירת סלאלומים שהם עיגול מושלם / מציאת מרכז המרחק בין שני נקודות על העיגול
divide_curve_5 = DivideCurve(Curve=arc_3.Arc, Count=מספק_חלוקות_3, Kinks=False)  # -> Points, Tangents, Parameters
cull_index_5 = CullIndex(List=divide_curve_5.Points, Indices="0", Wrap=True)
line_10 = Line(StartPoint=divide_curve_5.Points, EndPoint=cull_index_5)
curve_middle_9 = CurveMiddle(Curve=line_10)

# ---- group: יצירת סלאלומים שהם עיגול מושלם / הזזת נקודת האמצע במרחק של חצי האורך כדי לייצר בדיוק מרכז במרחק של רדיוס
distance_7 = Distance(PointA=divide_curve_5.Points, PointB=cull_index_5)
expression_9 = Expression(D=distance_7, Expression="D/2")
vector_2pt_5 = Vector2Pt(PointA=curve_middle_9, PointB=point_5, Unitize=False)  # -> Vector, Length
amplitude_5 = Amplitude(Vector=vector_2pt_5.Vector, Amplitude=expression_9)
move_8 = Move(Geometry=curve_middle_9, Motion=amplitude_5)  # -> Geometry, Transform

# ---- group: יצירת סלאלומים שהם עיגול מושלם / סיבוב כל קשת שנייה כדי לייצר זיגזג
arc_3pt_5 = Arc3Pt(PointA=divide_curve_5.Points, PointB=move_8.Geometry, PointC=cull_index_5)  # -> Arc, Plane, Radius
dispatch_12 = Dispatch(List=arc_3pt_5.Arc, DispatchPattern=[True, False])  # -> ListA, ListB
dispatch_13 = Dispatch(List=arc_3pt_5.Plane, DispatchPattern=[True, False])  # -> ListA, ListB
rotate_5 = Rotate(Geometry=dispatch_12.ListA, Angle=degrees(Slider(180, range=0..1000)), Plane=dispatch_13.ListA)  # -> Geometry, Transform

# ---- group: קביעת המרחק לאופסט ואז הרצה של אותו דבר
# הרדיוסים תכלס זהים צריך רק אחד מהם
panel_5 = Panel("0")
list_item_9 = ListItem(List=expression_9, Index=panel_5, Wrap=True)
expression_10 = Expression(R=list_item_9, x=number_slider_9, Expression="x*R")
offset_curve_5 = OffsetCurve(Curve=arc_3.Arc, Distance=expression_10, Corners=1)

# ---- group: יצירת סלאלומים שהם עיגול מושלם / מציאת מרכז המרחק בין שני נקודות על העיגול
divide_curve_6 = DivideCurve(Curve=offset_curve_5, Count=מספק_חלוקות_3, Kinks=False)  # -> Points, Tangents, Parameters
cull_index_6 = CullIndex(List=divide_curve_6.Points, Indices="0", Wrap=True)
line_11 = Line(StartPoint=divide_curve_6.Points, EndPoint=cull_index_6)
curve_middle_10 = CurveMiddle(Curve=line_11)

# ---- group: יצירת סלאלומים שהם עיגול מושלם / הזזת נקודת האמצע במרחק של חצי האורך כדי לייצר בדיוק מרכז במרחק של רדיוס
distance_8 = Distance(PointA=divide_curve_6.Points, PointB=cull_index_6)
expression_11 = Expression(D=distance_8, Expression="D/2")
vector_2pt_6 = Vector2Pt(PointA=curve_middle_10, PointB=point_5, Unitize=False)  # -> Vector, Length
amplitude_6 = Amplitude(Vector=vector_2pt_6.Vector, Amplitude=expression_11)
move_9 = Move(Geometry=curve_middle_10, Motion=amplitude_6)  # -> Geometry, Transform

# ---- group: בודק מה המרחק של הנקודות הקרובות ביותר בין שתי השכבות
curve_middle_11 = CurveMiddle(Curve=rotate_5.Geometry)
# לפעמים צריך להפוך את הכיוון של הקווים
# פשוט לכתוב מינוס איקס ב:
# expression
# או למחוק את ה-x
panel_6 = Panel("0")
list_item_10 = ListItem(List=curve_middle_11, Index="0", Wrap=True)
list_item_11 = ListItem(List=move_9.Geometry, Index=panel_6, Wrap=True)
distance_9 = Distance(PointA=list_item_10, PointB=list_item_11)
evaluate_3 = Evaluate(Expression="(0.2*W)<D", D=distance_9, W=עובי_הוצאת_חומר_ממ_3)  # -> flatten(Result)

# ---- group: פה משחקים עם הצורה (continued)
panel_7 = Panel(evaluate_3)

# ---- group: יצירת סלאלומים שהם עיגול מושלם / סיבוב כל קשת שנייה כדי לייצר זיגזג
# צריך לשים לב שבכל שכבה
# שנייה צריך להפוך אילו תת רשימה של עיגולים
# מכניסים לתוך הקומפוננט שמסובב
arc_3pt_6 = Arc3Pt(PointA=divide_curve_6.Points, PointB=move_9.Geometry, PointC=cull_index_6)  # -> Arc, Plane, Radius
dispatch_14 = Dispatch(List=arc_3pt_6.Arc, DispatchPattern=[True, False])  # -> ListA, ListB
dispatch_15 = Dispatch(List=arc_3pt_6.Plane, DispatchPattern=[True, False])  # -> ListA, ListB
rotate_6 = Rotate(Geometry=dispatch_14.ListB, Angle=degrees(Slider(180, range=0..1000)), Plane=dispatch_15.ListB)  # -> Geometry, Transform

# ----
# brick design
join_curves_8 = JoinCurves(Curves=[dispatch_12.ListB, rotate_5.Geometry], Preserve=False)
join_curves_9 = JoinCurves(Curves=[dispatch_14.ListA, rotate_6.Geometry], Preserve=False)

# ---- group: יצירת הקשתות והקווים שמחברים הכל לקו אחד רציף שאפשר להדפיס / יצירת הקשתות שיודפסו בפועל עם התחשבות בעובי חומר
list_item_12 = ListItem(List=expression_9, Index="0", Wrap=True)
expression_12 = Expression(R=list_item_12, W=עובי_הוצאת_חומר_ממ_3, Expression="R+0.2*W")
offset_curve_6 = OffsetCurve(Curve=arc_3.Arc, Distance=expr("-x", expression_12), Corners=1)

# ---- group: יצירת הקשתות והקווים שמחברים הכל לקו אחד רציף שאפשר להדפיס / סגירת הקשת והסלאלום
end_points_9 = EndPoints(Curve=join_curves_8)  # -> Start, End
end_points_10 = EndPoints(Curve=offset_curve_6)  # -> Start, End
line_12 = Line(StartPoint=end_points_10.Start, EndPoint=end_points_9.End)
join_curves_10 = JoinCurves(Curves=[line_12, offset_curve_6, join_curves_8], Preserve=False)

# ---- group: יצירת הקשתות והקווים שמחברים הכל לקו אחד רציף שאפשר להדפיס / סגירת הסלאלום הפנימי והחיצוני
end_points_11 = EndPoints(Curve=join_curves_10)  # -> Start, End
end_points_12 = EndPoints(Curve=join_curves_9)  # -> Start, End
line_13 = Line(StartPoint=end_points_11.Start, EndPoint=end_points_12.End)
join_curves_11 = JoinCurves(Curves=flatten([join_curves_9, line_13, join_curves_10]), Preserve=False)

# ---- group: יצירת הקשתות והקווים שמחברים הכל לקו אחד רציף שאפשר להדפיס / יצירת הקשתות שיודפסו בפועל עם התחשבות בעובי חומר
list_item_13 = ListItem(List=expression_11, Index="0", Wrap=True)
expression_13 = Expression(R=list_item_13, W=עובי_הוצאת_חומר_ממ_3, Expression="R+0.2*W")
offset_curve_7 = OffsetCurve(Curve=offset_curve_5, Distance=expression_13, Corners=1)

# ---- group: יצירת הקשתות והקווים שמחברים הכל לקו אחד רציף שאפשר להדפיס / סגירת הסלאלום החיצוני עם הקשת שתודפס בפועל
end_points_13 = EndPoints(Curve=offset_curve_7)  # -> Start, End
end_points_14 = EndPoints(Curve=join_curves_11)  # -> Start, End
line_14 = Line(StartPoint=end_points_14.Start, EndPoint=end_points_13.Start)
join_curves_12 = JoinCurves(Curves=flatten([line_14, offset_curve_7, join_curves_11]), Preserve=False)

# ----
curve_middle_12 = CurveMiddle(Curve=join_curves_12)
scale_3 = Scale(Geometry=join_curves_12, Center=curve_middle_12, Factor=Slider(1.5, range=0..10))  # -> Geometry, Transform
curve_3 = Curve(scale_3.Geometry)
move_10 = Move(Geometry=curve_3, Motion=unit_z_3)  # -> Geometry, Transform
curve_middle_13 = CurveMiddle(Curve=curve_3)
scale_4 = Scale(Geometry=move_10.Geometry, Center=curve_middle_13, Factor=Slider(0.9, range=0..10))  # -> Geometry, Transform
loft_3 = Loft(
    Curves=[curve_3, scale_4.Geometry],
    Options={Adjust=False, Closed=False, LoftEnds=0, LoftSimp=0, LoftType=0, Rebuild=10, Refit=0.01})
contour_3 = Contour(Shape=loft_3, Point=Point(0, 0, 0), Direction=unit_z_5, Distance=Slider(6, range=0..10))
dispatch_16 = Dispatch(List=contour_3, DispatchPattern=[True, False])  # -> ListA, ListB
flip_curve_3 = FlipCurve(Curve=dispatch_16.ListB)  # -> Curve, Flag
weave_3 = Weave(Pattern=[0, 1], Stream0=dispatch_16.ListA, Stream1=flip_curve_3.Curve, NullGaps=False)
# לפעמים צריך להפוך את הכיוון של הקווים
# פשוט לכתוב מינוס איקס ב:
# expression
# או למחוק את ה-x
# לפעמים צריך להפוך את הכיוון של הקווים
# פשוט לכתוב מינוס איקס ב:
# expression
# או למחוק את ה-x
divide_distance_3 = DivideDistance(Curve=contour_3, Distance=Slider(10, range=0..100), AddEnd=True)
flip_plane = FlipPlane(Plane=divide_distance_3, ReverseX=False, ReverseY=False, SwapAxes=True)
align_planes = AlignPlanes(Planes=flip_plane, Master=xy_plane)
move_11 = Move(Geometry=align_planes, Motion=unit_y)  # -> Geometry, Transform
move_12 = Move(Geometry=move_11.Geometry, Motion=unit_x)  # -> Geometry, Transform
move_13 = Move(Geometry=move_12.Geometry, Motion=unit_z_7)  # -> Geometry, Transform
rotate_7 = Rotate(Geometry=align_planes, Angle=Slider(180, range=0..1000), Plane=PlaneXY(0, 0, 0))  # -> Geometry, Transform
panel_8 = Panel(move_11.Geometry)
reverse_list = ReverseList(List=move_13.Geometry)

sddp = ShapeDiverDocumentPayload()
construct_point = ConstructPoint(XCoordinate=0, YCoordinate=0, ZCoordinate=Slider(610, range=0..1000))
list_3 = RobotsLibrary(
    {"MIT-ABB-IRB6640_sim", "KULeuven-IRB120", "KULeuven-UR5", "KULeuven-UR10", "iaac-KR150-2_110", "iaac-IRB140", "iaac-IRB120", "AA-KR60", "AA-KR30", "AA-KR60_KR30"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}, selected="Bartlett-UR10",
    Type=0)
mesh = Mesh(<mesh referenced from the Rhino model>)
# הגדרות בסיסיות
load_robot_system = LoadRobotSystem(Name=list_3, Base=PlaneXY(0, 0, 0))

construct_plane = ConstructPlane(Origin=construct_point, XAxis=Vector(1, 0, 0), YAxis=Vector(0, 1, 0))

create_tool = CreateTool(Name="Tool_01", TCP=construct_plane, Weight=Slider(4, range=0..10), Mesh=mesh)  # -> Tool, TCP

create_target = CreateTarget(
    Plane=flatten(reverse_list),
    RobConf=list,
    Motion=list_2,
    Tool=create_tool.Tool,
    Speed=Slider(50, range=0..150),
    Zone=Slider(20, range=0..100),
    IsCartesian=True)
panel_9 = Panel(create_target)
create_program = CreateProgram(Name="brick_24_6_04", RobotSystem=load_robot_system, Targets=create_target, StepSize=1)  # -> Program, Code, Duration, Warnings, Errors
panel_10 = Panel(create_program.Errors)
panel_11 = Panel(create_program.Code)
program_simulation = ProgramSimulation(Program=create_program.Program, Time=Slider(0, range=0..1000), Normalized=True)  # -> SystemMeshes, JointRotations, Plane, Index, Time, Program, Errors
save_program = SaveProgram(Program=create_program.Program, Folder=file_path)
simple_trail = SimpleTrail(Program=program_simulation.Program, Length=number_slider_7, MechanicalGroup=0)
curve_4 = Curve(simple_trail)
