# Grasshopper definition ראשי_2.gh (Grasshopper 1.0.7)
# plug-ins: Robots, Telepathy

# ---- group: הפרש גובה במ"מ בין בסיס רובוט למשטח הדפסה
# עם המספר הזה צריך לשחק לפני כל
# הדפסה אחרי שמוודאים שהמשטח פחות או יותר מפולס.
# מריצים את הקוד ברובוט על יבש:
# נניח האנד אפקטור גבוה מדי ב6 ס"מ מהמשטח,
# צריך להוסיף למספר הרשום פה 60.
# אם האנד אפקטור נתקע במשטח והוא נמוך מדי,
# צריך להפחית את הכמות שהוא גבוה מדי מהמספר פה.
height_difference = Slider(265, range=0..1000)
height_difference_2 = RemoteSender(height_difference)

# ----
# המשקל של האנד אפקטור בקילוגרם.
# להבנתי אמור לכלול גם את הצינור המחובר כשיש חומר בפנים
end_effector_weight_kg = Slider(0.8, range=0..10)
end_effector_weight_kg_2 = RemoteSender(end_effector_weight_kg)

# ----
# במידה ומדובר בצורה מעוקלת
# לעשות PASTE
# למה שהועתק מהקובץ
# Wall_designs
# 
# בצורה ישרה לא צריך את הנתון הזה
# מנסיוננו המר, בגיאומטריה מורכבת לא יכול לרדת מ30.
# לצערנו מגלים את זה רק בשלב הרצת הקוד ברובוט עצמו (או בסימולטור).
# צפיפות גבוה מדי של קווים עשתה לנו את השגיאה:
# C204A1 “Path sanity check: Sudden change in target position”
division_distance = Panel("20.142279")
division_distance_2 = RemoteSender(division_distance)

# ----
# דברים שצריך לקבוע
# לבחור האם הצורה ישרה או מעוקלת
# 
# False מעוקלת
# 
# True ישרה
is_straight_lines = BooleanToggle(False)
is_straight_line = RemoteSender(is_straight_lines)

# ----
# אם מדובר בצורה ישרה חייב להיות LINEAR
# 
# אם מדובר בצורה מעוקלת יכול להיות או זה או זה
value_list = ValueList({"Joint", "Linear"}, selected="Linear")
movement_type = RemoteSender(value_list)

# ---- group: שם הקובץ שיווצר עם הקוד
# בגדול השם של הקובץ חייב
# להיות שונה מכל שם אחר שהרובוט כבר הריץ
# הוא לא אוהב נקודות ולא נקודותיים
panel = Panel("omer2")
file_name = RemoteSender(panel)

# ---- group: הקו שמדפיסים
# להכניס את התוצר של ה-
# BAKE
# מהקובץ Wall_designs
# 
# במידה והצורה מעוקלת לשים לב שזה
# set multiple curves
# 
# בצורה ישרה מדובר בקו אחד רציף ולכן
# set one curve
curve = Curve(<curve referenced from the Rhino model>)

# ---- group: הגדרת הרובוט
# הגדרות קבועות בעיקרון
# list of models included in library
# more can be added manually
robots_library = RobotsLibrary(
    {"AA-KR60", "AA-KR30", "AA-KR60_KR30", "Taiwan-IRB1600", "Taiwan-KR6", "Taiwan-KR10", "TTDA-KR6", "TTDA-KR60", "TTDA-IIWA14", "UEL IRB6620"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}, selected="UR10",
    Type=0)
load_robot = LoadRobotSystem(Name=robots_library, Base=PlaneXY(0, 0, 0))

# ----
end_effector_weight_kg_3 = RemoteReceiver(end_effector_weight_kg_2)

# ---- group: הגדרת האנד אפקטור
# orientation relative to flange
# (use world origin as flange)
# no spaces
# tool center point (tcp)
# הצורה הממודלת של האנד אפקטור.
# הצורה שמורה באופן קבוע בתוך קובץ הגרסהופר הזה,
# ואם צריך משום מה לקשר מחדש נמצא בשכבות של הקובץ ריינו
tool_name = Panel("extruder")
point = Point(Point(0.1991195921, -3.743138918, 242.5852214))
mesh = Mesh(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)
construct_plane = ConstructPlane(Origin=point, XAxis=Vector(1, 0, 0), YAxis=Vector(0, 1, 0))
flip_plane = FlipPlane(Plane=construct_plane, ReverseX=False, ReverseY=False, SwapAxes=True)
create_tool = CreateTool(Name=tool_name, TCP=flip_plane, Weight=end_effector_weight_kg_3, Mesh=mesh)  # -> Tool, TCP

# ---- group: גבולות הדפסה של הרובוט. הגבולות נמצאים בתוך הקומפוננט
curve_2 = Curve(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)

# ---- group: הורדת הקו לגובה משטח ההדפסה
height_difference_3 = RemoteReceiver(height_difference_2)
unit_z = UnitZ(Factor=expr("-x", height_difference_3))
move = Move(Geometry=curve, Motion=unit_z)  # -> Geometry, Transform

# ---- group: חלוקת הקו לנקודות- צורה מעוקלת
division_distance_3 = RemoteReceiver(division_distance_2)
divide_length = DivideLength(Curve=move.Geometry, Length=division_distance_3)  # -> Points, Tangents, Parameters

# ---- group: חלוקת הקו לנקודות- צורה ישרה
divide_curve = DivideCurve(Curve=move.Geometry, Count=2, Kinks=True)  # -> flatten(Points), Tangents, Parameters

# ---- group: מזין לפה את האופציה המתאימה- חלוקה של קו מעוקל או של קו ישר
is_straight_line_2 = RemoteReceiver(is_straight_line)
stream_filter = StreamFilter(Gate=is_straight_line_2, Stream0=divide_length.Points, Stream1=divide_curve.Points)

# ---- group: מוסיף בתחילת הצורה קו להוצאת חומר
number_slider = Slider(0, range=0..100)
unit_y = UnitY(Factor=Slider(301, range=0..1000))
list_item = ListItem(List=stream_filter, Index=number_slider, Wrap=True)
move_2 = Move(Geometry=list_item, Motion=unit_y)  # -> Geometry, Transform
insert_items = InsertItems(List=stream_filter, Item=move_2.Geometry, Indices=number_slider, Wrap=False)
point_2 = Point(insert_items)

# ---- group: איך נראית גיאומטרית ההדפסה בפועל
cull_index = CullIndex(List=point_2, Indices="0", Wrap=True)
line = Line(StartPoint=point_2, EndPoint=cull_index)

# ---- group: יישור האנד אפקטור לנקודה
# aligns the extruder to look down and
# away from the base of the robot
construct_plane_2 = ConstructPlane(Origin=point_2, XAxis=Vector(1, 0, 0), YAxis=Vector(0, 1, 0))

# ----
panel_2 = Panel(construct_plane_2)
movement_type_2 = RemoteReceiver(movement_type)

# ---- group: יצירת הנקודות שהרובוט יעבור בהן
# החלטנו בעיקרון להתקבע על מהירות 400
# ולשחק רק עם קצב ההוצאה מהמכונת טיח.
# right click on the create target
# component to add aditional inputs
# כמה רחוק מהנקודה המוגדרת אנחנו מרשים לרובוט להתרחק.
# כרגע עבדנו על 10 מ"מ ונראה שזה סבבה מבחינתו
# ולא עקשני מדי.
cut_speed = Panel("400")
approximation_zone = Panel("10")
create_target = CreateTarget(
    Plane=construct_plane_2,
    Motion=movement_type_2,
    Tool=create_tool.Tool,
    Speed=cut_speed,
    Zone=approximation_zone,
    IsCartesian=True)

# ---- group: מדליק ומכבה את המכשיר. כרגע אנחנו לא משתמשים בזה כדי להדליק ולכבות את המכונת טיח אבל שישאר
# Adds commands to the first and last target that turn on
# and off the first digital output. Zone is set to 0 (stop point)
# to sync the commands with the position of the robot.
digital_output_num = Panel("0")
list_item_2 = ListItem(List=create_target, Index=0, Wrap=True)  # -> Item1, Item
approach_speed = Panel("200")
stop_zone = Panel("0")
set_do = SetDO(DO=digital_output_num, Value="1")
set_do_2 = SetDO(DO=digital_output_num, Value="0")
speed_parameter = SpeedParameter(approach_speed)
zone_parameter = ZoneParameter(stop_zone)
create_target_2 = CreateTarget(Target=list_item_2.Item, Speed=speed_parameter, Zone=zone_parameter, Command=set_do, IsCartesian=True)
create_target_3 = CreateTarget(Target=list_item_2.Item1, Zone=zone_parameter, Command=set_do_2, IsCartesian=True)
merge = Merge(Data1=create_target_2, Data2=create_target_3)
panel_3 = Panel("""0
-2""")
replace_items = ReplaceItems(List=create_target, Item=merge, Indices=panel_3, Wrap=True)
target_list = RemoteSender(replace_items)

# ----
target_list_2 = RemoteReceiver(target_list)

# ---- group: הגדרת פוזיצית בית לרובוט
# הערכים פה מעלים את הרובוט למקום שנוח
# להתעסק איתו ולא מתוח מדי.
# אפשר להעמיד את הרובוט ידנית עם הFreedrive
# ולהחליף את הערכים פה למשהו חדש.
# הוא מגיע לפוזיציה הזאת בתחילת הקוד ובסופו.
# A home position should be set
# using joint rotation values. This is
# the only way to unambiguously
# define a robot pose.
home_position = Panel("0,-45/180*pi,65/180*pi,-110/180*pi,-90/180*pi,-90/180*pi")
approach_speed_2 = Panel("200")
panel_4 = Panel("""0
-1""")
create_target_4 = CreateTarget(Joints=home_position, Tool=create_tool.Tool, Speed=approach_speed_2, Zone="20", IsCartesian=False)
insert_items_2 = InsertItems(List=target_list_2, Item=create_target_4, Indices=panel_4, Wrap=True)

# ---- group: יצירת הקוד
file_name_2 = RemoteReceiver(file_name)
create_program = CreateProgram(Name=file_name_2, RobotSystem=load_robot, Targets=insert_items_2, StepSize=1)  # -> Program, Code, Duration, Warnings, Errors

# ---- group: בודק אם הרובוט מתנגש במעמד כשהוא מדפיס את הצורה הנבחרת / המעמד של הרובוט
mesh_2 = Mesh(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)

# ---- group: בודק אם הרובוט מתנגש במעמד כשהוא מדפיס את הצורה הנבחרת / בוחר את הזרועות של הרובוט
series = Series(Start=Slider(2, range=0..100), Step=Slider(1, range=0..1), Count=Slider(6, range=0..10))
create_set = CreateSet(List=series)  # -> Set, Map

# ----
panel_5 = Panel(create_program.Errors)
panel_6 = Panel(create_program.Warnings)

# ---- group: הרצת הדמיה של הקובץ שייצרנו
# אפשר להריץ עם פליי דרך הסימולציה
#  או להריץ את הסליידר של הזמן
# ההדמייה הזאת לא חוזה בעיות בקוד
# אבל כדאי לראות את התנוחות
# שהרובוט צריך לעבור בהן
number_slider_2 = Slider(0, range=0..1)
program_simulation = ProgramSimulation(Program=create_program.Program, Time=number_slider_2, Normalized=True)  # -> SystemMeshes, JointRotations, Plane, Index, Time, Program, Errors
simple_trail = SimpleTrail(Program=program_simulation.Program, Length=500, MechanicalGroup=0)
time = Panel(program_simulation.Time)

# ---- group: שידור הקוד בצורה אלחוטית לרובוט. טרם השתמשנו
remote_connection = RemoteConnection(Program=create_program.Program, IP="sft://0.0.0.0", Upload=Toggle(False), Play=Toggle(False), Pause=Toggle(True))

# ---- group: בודק אם הרובוט מתנגש במעמד כשהוא מדפיס את הצורה הנבחרת
check_collisions = CheckCollisions(
    Program=create_program.Program,
    FirstSet=create_set.Set,
    SecondSet=8,
    Environment=mesh_2,
    EnvironmentPlane=-1,
    LinearStepSize=100,
    AngularStepSize=0.7853981634)  # -> CollisionFound, TargetIndex, CollidedMeshes
evaluate = Evaluate(Expression="IF(x=True, 75, 0)", x=check_collisions.CollisionFound)
symbol_simple = SymbolSimple(Style=3, Size=evaluate, Rotation=0, Colour=RGB(255, 1, 11))
point_3 = Point(Point(0, 0, 0))
symbol_display = SymbolDisplay(Location=point_3, Display=symbol_simple)

# ----
file_path = FilePath("/Users/user/Desktop/")

# ---- group: שמירת הקובץ בתיקייה ייעודית במחשב שצריך להגדיר. כדאי לעשות דיסאייבל כל פעם שמשנים את הקוד ואז אנאייבל
save_program = SaveProgram(Program=create_program.Program, Folder=file_path)

# ---- group: בודק אם הרובוט מתנגש במעמד כשהוא מדפיס את הצורה הנבחרת / אילו חלקים מתנגשים
mesh_3 = Mesh(check_collisions.CollidedMeshes)

# ----
robot_program = Panel(create_program.Code)
