# Grasshopper definition תמונה_קו_(פרידה קאלו).gh (Grasshopper 1.0.7)
# plug-ins: Javid

bitmap = Bitmap(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)
number_slider = Slider(30, range=0..100)
number_slider_2 = Slider(60, range=0..100)
bitmap_2 = Bitmap(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)
undulant = Undulant(Bitmap=bitmap, Ex=number_slider, Ey=number_slider_2, Amplitude=0.5)
undulant_2 = Undulant(Bitmap=bitmap_2, Ex=number_slider, Ey=number_slider_2, Amplitude=0.5)
recmap = RectangleMapping(Geometry=undulant, Source=bitmap, Target=bitmap_2)  # -> Geometry, Transform
tweencrv = TweenCurve(CurveA=recmap.Geometry, CurveB=undulant_2, Factor=Slider(0, range=0..1), BlendType=0)
