# Grasshopper definition תמונה_קו_עגול_(קניה ווסט).gh (Grasshopper 1.0.7)
# plug-ins: Javid

B = Bitmap(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)
bmpdis = DisplayBitmap(Bitmap=B)
cir = Circle(Plane=B, Radius=Slider(200, range=0..300))
divide = DivideCurve(Curve=cir, Count=Slider(300, range=0..1000), Kinks=False)  # -> Points, Tangents, Parameters
list = ValueList({"Average": 0, "Sum": 1}, selected="Average")
strart = StringArt(
    Bitmap=B,
    Pins=divide.Points,
    LineCount=Slider(4000, range=0..10000),
    LineWidth=1,
    LineWeight=50,
    SkipLatestPins=3,
    SkipNeighbors=20,
    Method=list,
    Iterations=10,
    Run=Toggle(True),
    Reset=Button())  # -> PinsOrder, Lines, Bitmap
preview_bitmap = PreviewBitmap(Bitmap=strart.Bitmap, LockAspect=True)
