# Grasshopper definition הדפסת_חול_3.gh (Grasshopper 1.0.7)
# plug-ins: Axolotl Info

# ----
# Handle main body
number_slider = Slider(10, range=0..100)
cylinders_center_point = Point(Point(125, 0, 0))
box = Box(
    DimensionX=Slider(30, range=0..500),
    DimensionY=Slider(30, range=0..100),
    DimensionZ=number_slider,
    Radius=Slider(1.5, range=0..10),
    Plane=PlaneXY(0, 0, 0))
cylinder = Cylinder(Radius=Slider(35.8, range=0..100), Height=number_slider, Plane=cylinders_center_point, Fillet=0)
boolean_union = BooleanUnion(DistanceObjectS=cylinder, DistanceObject=box)

# ----
# TPMS Lattice structure
number_slider_2 = Slider(5.4, range=0..10)
tpms = TPMS(Wavelength=number_slider_2, type=0)
shell = Shell(DistanceObject=tpms, Thickness=Slider(2.1, range=0..10), Factor=0.5)

cylinder_2 = Cylinder(Radius=Slider(3.5, range=0..10), Height="16", Plane=PlaneXY(0, 0, 0), Fillet=0)
mult = Mult(DistanceObject=cylinder_2, Factor=Slider(0.2, range=-0.5..0.5))
box_2 = CenterBox(Base=PlaneXY(0, 0, 0), X="5", Y="5", Z="5")
number_slider_3 = Slider(3.5, range=0..10)
number_slider_4 = Slider(5, range=0..10)
number_slider_5 = Slider(1, range=0..10)
number_slider_6 = Slider(4, range=0..10)
number_slider_7 = Slider(6, range=0..10)
pop3d = Populate3D(Region=box_2, Count=Slider(32, range=0..100), Seed=1)
distance_wrapper = DistanceWrapper(Geometry=pop3d)
sine_3d = Sine3D(XFrequency=1, XPhase=0, XAmplitude=1, YFrequency=1, YPhase=0, YAmplitude=1, ZFrequency=1, ZPhase=0, ZAmplitude=1)
tpms_2 = TPMS(Wavelength=number_slider_3, type=0)
tpms_polar = TPMSP(Wavelength=number_slider_3, Polar=number_slider_7, type=3)
tpms_spherical = TPMSS(Wavelength=number_slider_3, Azimuth=number_slider_4, Inclination=number_slider_4, type=2)
tpms_distance_object_modifier = TPMSD(Wavelength=number_slider_3, Modulator=mult, type=4)
lattice = Lattice(Cellsize=number_slider_6, Thickness=number_slider_5, type=0)
latticepolar = LatticePolar(Cellsize=number_slider_6, Thickness=number_slider_5, Polar=number_slider_7, type=6)
voronoi = Voronoi(DistanceObjects=distance_wrapper, Thickness=Slider(0.2, range=0..1), type=0)
noise = Noise(Frequency=Slider(0.5, range=0..1), RandomSeed="3407", type=8)

# ----
# box to be sampled
# custom math expression
# must compute one scalar value
# from inputs x, y and z
# number of sample points
# in X, Y and Z
# decompose points
# into components
# isosurface from computed
# scalar field
number_slider_8 = Slider(32, range=0..100)
sphere = Sphere(Radius=4, Center=Point(0, 0, 0))
box_3 = CenterBox(Base=PlaneXY(0, 0, 0), X="5", Y="5", Z="5")
dense_grid = DenseGrid(DistanceObject=sphere, Box=box_3, NumberX=number_slider_8, NumberY=number_slider_8, NumberZ=number_slider_8, type=0)  # -> Values, Points
pdecon = Deconstruct(Point=dense_grid.Points)  # -> XComponent, YComponent, ZComponent
expression = Expression(x=pdecon.XComponent, y=pdecon.YComponent, z=pdecon.ZComponent, Expression="sin(x)*cos(y)+sin(y)*cos(z)")
isosurface_distancefield = IsosurfaceDistancefield(
    Values=expression,
    BoundingBox=box_3,
    NumberX=number_slider_8,
    NumberY=number_slider_8,
    NumberZ=number_slider_8,
    Isovalue=0)

merge = Merge(
    Data1=lattice,
    Data2=latticepolar,
    Data3=tpms_2,
    Data4=tpms_polar,
    Data5=tpms_spherical,
    Data6=tpms_distance_object_modifier,
    Data7=noise,
    Data8=sine_3d,
    Data9=voronoi)  # -> flatten(Result)
knob = ControlKnob(Decimals=0, Limit=False, Maximum=10, Minimum=0, Range=10, Value=1)
item = ListItem(List=merge, Index=knob, Wrap=False)
isosurface_distancefunction = IsosurfaceDistancefunction(NumberX=50, NumberY=50, NumberZ=50, Isovalue=0, Capped=False, DistanceObject=item, Refine=True)

# ----
# Bounding box
number_slider_9 = Slider(-125, range=-125..0)
number_slider_10 = Slider(18, range=0..20)
number_slider_11 = Slider(8, range=0..10)
neg = Negative(Value=number_slider_11)
neg_2 = Negative(Value=number_slider_10)
dom = ConstructDomain(DomainStart=neg, DomainEnd=number_slider_11)
dom_2 = ConstructDomain(DomainStart=neg_2, DomainEnd=number_slider_10)
dom_3 = ConstructDomain(DomainStart=number_slider_9, DomainEnd=Slider(145, range=0..1000))
box_4 = DomainBox(Base=PlaneXY(0, 0, 0), X=dom_3, Y=dom_2, Z=dom)
edges = BrepEdges(Brep=box_4)  # -> Naked, Interior, NonManifold

# ----
# Resolution from voxel size
number_slider_12 = Slider(0.38, range=0..1)
voxel_size = VoxelSize(BoundingBox=box_4, UnitCell=number_slider_12)  # -> NumberX, NumberY, NumberZ

vec = Vector(Vector(-1, 0, 0))
plane = Plane(Normal=vec)

# ----
# Gradient thickening
number_slider_13 = Slider(0.004, range=0..0.01)
overlay = Overlay(DistanceObject=shell, DistanceObject_2=plane, Factor=number_slider_13)

# ----
# Handle taper
number_slider_14 = Slider(-0.02, range=-0.02..0)
overlay_2 = Overlay(DistanceObject=boolean_union, DistanceObject_2=plane, Factor=number_slider_14)

boolean_intersect = BooleanIntersect(DistanceObjectS=overlay_2, DistanceObject=overlay)

# ----
# Hole reinforcement
number_slider_15 = Slider(15.5, range=0..100)
cylinder_3 = Cylinder(Radius=Slider(12, range=0..100), Height=number_slider_15, Plane=cylinders_center_point, Fillet=Slider(1.1, range=0..10))
boolean_union_2 = BooleanUnion(DistanceObjectS=cylinder_3, DistanceObject=boolean_intersect)

# ----
# Cut hole
number_slider_16 = Slider(10, range=0..10)
cylinder_4 = Cylinder(Radius=number_slider_16, Height=Slider(20, range=0..100), Plane=cylinders_center_point, Fillet=0)
boolean_subtract = BooleanSubtract(DistanceObject=boolean_union_2, DistanceObject_2=cylinder_4)

# ----
# Isosurface
isosurface_distancefunction_2 = IsosurfaceDistancefunction(
    BoundingBox=box_4,
    NumberX=voxel_size.NumberX,
    NumberY=voxel_size.NumberY,
    NumberZ=voxel_size.NumberZ,
    Isovalue=0,
    Capped=False,
    DistanceObject=boolean_subtract,
    Refine=True)
